# Grasshopper definition GHDebugSurface.gh (Grasshopper 1.0.7)

# ---- group: Surface
panel = Panel("""{0.5,0.5,0.0}
{0.1,0.1,0.0}
{1,1,0.0}""")
# All these definitions were used to convalidate and developed the GeometrySharp surfaces tests.
srf4pt = _4PointSurface(CornerA="{0.0, 0.0, 0.0}", CornerB="{10.0, 0.0, 0.0}", CornerC="{10.0, 10.0, 2.0}", CornerD="{0.0, 10.0, 4.0}")
evalsrf = EvaluateSurface(Surface=reparameterize(srf4pt), Point=panel)  # -> Point, Normal, UDirection, VDirection, Frame
panel_2 = Panel(evalsrf.Point)
